# Grasshopper definition AFDLC-HATCHES.gh (Grasshopper 0.9.76)
# plug-ins: LunchBox

# ---- group: Inputs
hatch_min = Slider(7, range=0..10)
height = Slider(65, range=0..100)
h_w_ratio = Slider(1.5, range=0..10)
hatch_mid = Slider(9, range=0..10)
hatch_max = Slider(11, range=0..100)
# UNITS ARE IN MM
boundary = Curve(<curve referenced from the Rhino model>)

# ----
srf = Surface(boundary)
num = Number(height)
num_2 = Number(h_w_ratio)
num_3 = Number(hatch_min)
num_4 = Number(hatch_mid)
num_5 = Number(hatch_max)

# ---- group: Diamond grid
offset = Offset(Curve=srf, Distance=expr("-x", num), Plane=PlaneXY(0, 0, 0), Corners=1)
multiplication = Multiplication(A=num, B=num_2)
boundary_2 = BoundarySurfaces(Edges=offset)
dim = Dimensions(Surface=boundary_2)  # -> UDimension, VDimension
division = Division(A=dim.UDimension, B=multiplication)
division_2 = Division(A=dim.VDimension, B=num)
diamond = DiamondPanels(Surface=boundary_2, UDivisions=division, VDivisions=division_2)  # -> simplify(flatten(DiamondPanels)), simplify(flatten(TriPanels))

# ---- group: Random Picks
lng = ListLength(List=diamond.DiamondPanels)
lng_2 = ListLength(List=diamond.DiamondPanels)
random = Random(Range=Domain(-0.49, 1.49), Number=lng, Seed=11)
random_2 = Random(Range=Domain(-0.49, 2.49), Number=lng_2, Seed=10)
round = Round(Number=random)  # -> simplify(graft(Nearest)), Floor, Ceiling
round_2 = Round(Number=random_2)  # -> simplify(graft(Nearest)), Floor, Ceiling
p_n_c = PickNChoose(Pattern=round_2.Nearest, Stream0=num_3, Stream1=num_4, Stream2=num_5)  # -> flatten(Result)

# ---- group: Hatch
debrep = DeconstructBrep(Brep=diamond.DiamondPanels)  # -> Faces, Edges, Vertices
addition = Addition(A=round.Nearest, B=2)
item = ListItem(List=debrep.Edges, Index=round.Nearest, Wrap=True)  # -> flatten(Item)
item_2 = ListItem(List=debrep.Edges, Index=addition, Wrap=True)  # -> flatten(Item)
end = EndPoints(Curve=item_2)  # -> Start, End
ln = Line(StartPoint=end.End, EndPoint=end.Start)
divide = DivideCurve(Curve=item, Count=p_n_c, Kinks=False)  # -> Points, Tangents, Parameters
divide_2 = DivideCurve(Curve=ln, Count=p_n_c, Kinks=False)  # -> Points, Tangents, Parameters
ln_2 = Line(StartPoint=divide.Points, EndPoint=divide_2.Points)  # -> simplify(Line)

# ---- group: Projected pattern
boundary_3 = BoundarySurfaces(Edges=srf)
project = Project(Curve=ln_2, Brep=boundary_3, Direction=Vector(0, 0, 1))

# ----
crv = Curve(project)
